# Grasshopper definition groundtrack_example.gh (Grasshopper 1.0.8)
# plug-ins: groundtrack

# ---- group: 1 Field -> Streamlines: pick site / clip / group
site = ValueList({"trafalgar_square", "tottenham_court_road", "reuters_plaza", "blackwall_motorway"}, selected="reuters_plaza")
clip = ValueList({"whole", "plaza1", "plaza2", "plaza3"}, selected="whole")
group = ValueList({"people"}, selected="people")
field = Field(Site=site, Clip=clip, Group=group, Window=5, Heights=True)  # -> Field, Points, Vectors, Speed, Density, Colour, Info
stream = Streamlines(Field=field.Field, Density=0.5, MinConfidence=0.05)  # -> Curves, Speed, Colour, Spacing

# ---- group: 2 Particles + Replay on a Timeline (moved 70 m east): double-click the Timeline to play / scrub / record
site_2 = ValueList({"trafalgar_square", "tottenham_court_road", "reuters_plaza", "blackwall_motorway"}, selected="reuters_plaza")
clip_2 = ValueList({"whole", "plaza1", "plaza2", "plaza3"}, selected="plaza1")
group_2 = ValueList({"people"}, selected="people")
field_2 = Field(Site=site_2, Clip=clip_2, Group=group_2, Window=5, Heights=True)  # -> Field, Points, Vectors, Speed, Density, Colour, Info
move = Move(Geometry=field_2.Field, Translation=Vector(70, 0, 0))
time = Timeline(FPS=30, Window=False, gt_current=0, gt_fps=30, gt_in=0, gt_loop=True, gt_out=30, gt_speed=1)  # -> T, Frame, Playing
pop = Particles(Field=move, Time=time.T, Run=False, Reset=False, Rate=300, Speed=1, Noise=0, Trail=2, Seed=1)  # -> Points, Velocity, Speed, Colour, Trails, Age, Time
replay = Replay(Field=move, Time=time.T, Tail=3)  # -> Points, Velocity, Speed, Colour, Trails, Id, Range

# ---- group: 3 Two clips: Blend (T slider) and where their flows cross (heat map), 140 m east
site_3 = ValueList({"trafalgar_square", "tottenham_court_road", "reuters_plaza", "blackwall_motorway"}, selected="reuters_plaza")
clip_3 = ValueList({"whole", "plaza1", "plaza2", "plaza3"}, selected="plaza1")
group_3 = ValueList({"people"}, selected="people")
field_3 = Field(Site=site_3, Clip=clip_3, Group=group_3, Window=5, Heights=True)  # -> Field, Points, Vectors, Speed, Density, Colour, Info
site_4 = ValueList({"trafalgar_square", "tottenham_court_road", "reuters_plaza", "blackwall_motorway"}, selected="reuters_plaza")
clip_4 = ValueList({"whole", "plaza1", "plaza2", "plaza3"}, selected="plaza3")
group_4 = ValueList({"people"}, selected="people")
field_4 = Field(Site=site_4, Clip=clip_4, Group=group_4, Window=5, Heights=True)  # -> Field, Points, Vectors, Speed, Density, Colour, Info
move_2 = Move(Geometry=field_3.Field, Translation=Vector(140, 0, 0))
move_3 = Move(Geometry=field_4.Field, Translation=Vector(140, 0, 0))
blend = BlendFields(Fields=[move_2, move_3], T=0.5)  # -> Field, Weights
stream_2 = Streamlines(Field=move_2, Density=0.5, MinConfidence=0.05)  # -> Curves, Speed, Colour, Spacing
stream_3 = Streamlines(Field=move_3, Density=0.5, MinConfidence=0.05)  # -> Curves, Speed, Colour, Spacing
cross = Crossings(A=stream_2.Curves, B=stream_3.Curves)  # -> Points, Angle, AIndex, BIndex, Count, Heat
